# Dynamo graph simpletest.dyn (Dynamo 0.7.2.2921)

byCoordinates = Point.ByCoordinates()
double_slider = DoubleSlider(47.119, range=0..100)
double_slider_2 = DoubleSlider(59.46, range=0..100)
byCoordinates_2 = Point.ByCoordinates(double_slider, double_slider_2)
code_block = CodeBlock { "Steel"; }
code_block_2 = CodeBlock { "W12x16"; }
integer_slider = IntegerSlider(4, range=0..7)
double_slider_3 = DoubleSlider(30, range=0..100)
fromEndPoints = DynamoSAP.Structure.Frame.FromEndPoints(byCoordinates, byCoordinates_2, code_block, code_block_2, integer_slider, double_slider_3)
baseCurve = DynamoSAP.Structure.Frame.BaseCurve(fromEndPoints)
rotation = DynamoSAP.Structure.Frame.Rotation(fromEndPoints)
toString = ToString(fromEndPoints)
code_block_3 = CodeBlock { "mysds"; }
integer_slider_2 = IntegerSlider(28, range=0..100)
double_slider_4 = DoubleSlider(28.379, range=0..100)
createSAPModel = DynamoSAP.Assembly.SAPModel.CreateSAPModel(fromEndPoints)
watch = Watch(createSAPModel)
boolean = BoolSelector(true)
